# Grasshopper definition HVACSystemWorkflow.gh (Grasshopper 1.0.7)
# plug-ins: Ironbug

brep = Brep([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])

objparams = Ironbug_ObjParams(PressureRise="407", DataFieldSetType="Ironbug.HVAC.IB_FanConstantVolume_DataFields")
fanconstant = Ironbug_FanConstantVolume(Parameters=objparams)

intersectmass = IntersectMass(x=brep)  # -> out, A; inputs x: list of Brep
# ---------- intersectmass: C# ----------
    var tolerance = Rhino.RhinoDoc.ActiveDoc.ModelAbsoluteTolerance;
    List<Brep> allOldBreps = x;

    if (x.Count() > 0)
    {
      var results = allOldBreps.AsParallel().AsOrdered().Select(b => SplitBrepWithBreps(b, allOldBreps, tolerance));
      A = results;
    }

    //SplitBrepWithBreps(x[0], x, tolerance);
# ---------- intersectmass: C# additional code ----------
  static Brep SplitBrepWithBreps(Brep CurrentBrep, List<Brep> AllBreps, double tolerance)
  {
    var currentBrep = CurrentBrep;
    var allBreps = AllBreps;

    foreach (Brep item in allBreps)
    {
      var  tempBrep = currentBrep.Split(item, tolerance);
      if (tempBrep.Count() > 0)
      {
        var newBrep = Rhino.Geometry.Brep.JoinBreps(tempBrep, tolerance);

        currentBrep = newBrep.First();
        currentBrep.Faces.ShrinkFaces();
      }
    }
    return currentBrep;

  }
# ---------- end intersectmass ----------
honeybee = Honeybee_Honeybee()  # -> Vviiiiiiiiiizzz; plug-in component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
ladybug = Ladybug_Ladybug()  # -> Vviiiiiiiiiizzz; plug-in component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
number_slider = Slider(0.7, range=0..1)
objparams_2 = Ironbug_ObjParams(EconomizerControlType="DifferentialDryBulb", DataFieldSetType="Ironbug.HVAC.IB_ControllerOutdoorAir_DataFieldSet")
mass2zone = Honeybee_Masses2Zones(zoneMasses=flatten(intersectmass.A), maxRoofAngle=30, createHBZones=Toggle(True))  # -> readMe, HBZones; plug-in component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
panel = Panel("https://www.energyplus.net/weather-download/north_and_central_america_wmo_region_4/USA/NY/USA_NY_New.York-LaGuardia.AP.725030_TMY3/all")
oacontroller = Ironbug_OAController(Parameters=objparams_2)
objparams_3 = Ironbug_ObjParams(PressureRise="500", DataFieldSetType="Ironbug.HVAC.IB_FanConstantVolume_DataFields")
glzparamlist = Honeybee_GlazingParametersList(northGlzParam=0, westGlzParam=0, southGlzParam=number_slider, eastGlzParam=number_slider)  # -> glzParamList; plug-in component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
solveadjc = Honeybee_SolveAdjacencies(HBZones=flatten(mass2zone.HBZones), removeCurrentAdjc=False, findAdjc=Toggle(True))  # -> readMe, HBZonesWADJ; plug-in component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
glazingcreator = Honeybee_GlazingBasedOnRatio(HBObjects=solveadjc.HBZonesWADJ, glzRatio=glzparamlist, runIt=Toggle(True))  # -> readMe, HBObjWGLZ; plug-in component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
data = Data(flatten(glazingcreator.HBObjWGLZ))
epw_stat = Ladybug_OpenEPWAndSTATWeatherFiles(weatherFileURL=panel)  # -> epwFile, statFile; plug-in component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
hvacsystemslist = Honeybee_HVACSystemsList({"-1. Thermostat Only": -1, "0. Ideal Air Loads": 0, "1. PTAC | Residential": 1, "2. PTHP | Residential": 2, "3. Packaged Single Zone - AC": 3, "4. Packaged Single Zone - HP": 4, "5. Packaged VAV w/ Reheat": 5, "6. Packaged VAV w/ PFP Boxes": 6, "7. VAV w/ Reheat": 7, "8. VAV w/ PFP Boxes": 8, "9. Warm Air Furnace - Gas Fired": 9, "10.Warm Air Furnace - Electric": 10, "11.Fan Coil Units + DOAS": 11, "12.Active Chilled Beams + DOAS": 12, "13.Radiant Floors + DOAS": 13, "14.Custom Rad Surfaces + DOAS": 14, "15.Heated Surfaces + VAV Cooling": 15, "16.VRF + DOAS": 16, "17.WSHP + DOAS": 17}, selected="3. Packaged Single Zone - AC")
hvacsystem = Honeybee_AssignHVACSystem(HBZones=graft(glazingcreator.HBObjWGLZ), HVACSystems=hvacsystemslist)  # -> readMe, HBZones; disabled; plug-in component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
toggle = BooleanToggle(False)  # disabled
toggle_2 = BooleanToggle(False)
toggle_3 = BooleanToggle(False)
panel_2 = Panel("OPS_Sys")  # disabled
exporttoopenstudio = Honeybee_ExportToOpenStudio(epwWeatherFile=epw_stat.epwFile, HBZones=flatten(glazingcreator.HBObjWGLZ), writeOSM=toggle, fileName=panel_2)  # -> readMe, osmFileAddress, idfFileAddress, resultFileAddress, eioFileAddress, rddFileAddress, htmlReport, studyFolder, model; disabled; plug-in component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
exporttoopenstudio_2 = Honeybee_ExportToOpenStudio(
    epwWeatherFile=epw_stat.epwFile,
    HBZones=flatten(hvacsystem.HBZones),
    writeOSM=toggle_2,
    openOpenStudio=toggle_2,
    fileName="HB_Sys")  # -> readMe, osmFileAddress, idfFileAddress, resultFileAddress, eioFileAddress, rddFileAddress, htmlReport, studyFolder, model; plug-in component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
c_script = CSharpScript(x=exporttoopenstudio.osmFileAddress, Reference="C:\openstudio-2.5.0\CSharp\openstudio\OpenStudio.dll")  # -> out, A; inputs x: String; disabled
# ---------- c_script: C# ----------
    if (string.IsNullOrEmpty(x))
    {
      return;
    }

    var p = new OpenStudio.Path(x);
    var m_o = OpenStudio.Model.load(p);
    Print(m_o.is_initialized().ToString());
    var m = m_o.get();
    var zs = m.getThermalZones();
    foreach (OpenStudio.ThermalZone z in zs)
    {
      
      var eqps = z.equipment();
      foreach (var e in eqps)
      {
		 e.remove();
      }
    }
    OpenStudio.OpenStudioModelHVAC.addSystemType1(m, zs);

    m.save(p, true);
# ---------- end c_script ----------
panel_3 = Panel(exporttoopenstudio.osmFileAddress)  # disabled
panel_4 = Panel(c_script.out)  # disabled

panel_5 = Panel("""1
0
0
0
0
0""")
cvbiquadratic = Ironbug_CurveBiquadratic(Coefficients=panel_5)
objparams_4 = Ironbug_ObjParams(
    EfficiencyCurveTemperatureEvaluationVariable="LeavingBoiler",
    NormalizedBoilerEfficiencyCurve=cvbiquadratic,
    DataFieldSetType="Ironbug.HVAC.IB_BoilerHotWater_DataFields")

objparams_5 = Ironbug_ObjParams(PressureRise="300", DataFieldSetType="Ironbug.HVAC.IB_FanConstantVolume_DataFields")
fanconstant_2 = Ironbug_FanConstantVolume(Parameters=objparams_5)

timer = Timer(TimerInterval=1000)
list = ValueList({"One": 1, "Two": 2, "Three": 2² - 1, "Four": Sqrt(16)}, selected="One")
knob = ControlKnob(Decimals=2, Limit=True, Maximum=10, Minimum=0, Range=1, Value=1.03)
digit_scroller = DigitScroller(Scroller_Digits=12, Scroller_Radix=9, Scroller_Value=0.25)
item = CherryPicker(ListIndex=0)
gradient = Gradient(LowerLimit=0, UpperLimit=1, stops=[0.15: RGB(255, 130, 160), 0.85: RGB(220, 0, 40)])
dam = DataDam(BufferDelay=10000000, BufferMode=0)
nblur = BlurNumbers(Strength=0.5, Iterations=1, Lock=True, Wrap=False)
hvactemplate = Ironbug_HVACTemplate(_run=Button())
list_2 = ValueList({"One": 1, "Two": 2, "Three": 2² - 1, "Four": Sqrt(16)}, selected="One")

# ----
# PTAC
coilhw = Ironbug_CoilHeatingWater()  # -> AirSide_CoilHeatingWater, WaterSide_CoilHeatingWater
ptac = Ironbug_ZoneHVACPackagedTerminalAirConditioner(HeatingCoil=coilhw.AirSide_CoilHeatingWater, Fan_=fanconstant)

diffuser = Ironbug_AirTerminalSingleDuctUncontrolled()
thermalzone = Ironbug_ThermalZone(HoneybeeZone=data, AirTerminal_=diffuser)
oasystem = Ironbug_OutdoorAirSystem(Controller_=oacontroller)
coilcdxsgl = Ironbug_CoilCoolingDXSingleSpeed()
coilhg = Ironbug_CoilHeatingGas()
coilhg_2 = Ironbug_CoilHeatingGas()
fanconstant_3 = Ironbug_FanConstantVolume(Parameters=objparams_3)
lng = ListLength(List=thermalzone)
graft = GraftTree(Tree=thermalzone, IncludeEmptyLists=True, IncludeNullItems=True)
merge = Merge(Data1=oasystem, Data2=coilcdxsgl, Data3=coilhg, Data5=fanconstant_3)  # -> simplify(Result)
spszreheat = Ironbug_SetpointManagerSingleZoneReheat(ControlZone=graft, MinTemperature="-20", MaxTemperature="100")
duplicate = Ironbug_Duplicate(Reference=merge, Amount=lng)  # -> Objects, port
flip = FlipMatrix(Data=duplicate.Objects)
branches = AirLoopBranches(Branch1=graft)
merge_2 = Merge(Data1=flip, Data2=spszreheat)

objparams_6 = Ironbug_ObjParams(
    AllOutdoorAirinCooling=Toggle(False),
    AllOutdoorAirinHeating=Toggle(False),
    CentralHeatingDesignSupplyAirTemperature="40",
    MinimumSystemAirFlowRatio="1",
    DataFieldSetType="Ironbug.HVAC.IB_SizingSystem_FieldSet")

szsystem = Ironbug_SizingSystem(Parameters=objparams_6)
airloop = Ironbug_AirLoopHVAC(Supply=merge_2, Demand=branches, SizingSystem=szsystem)
hvacsystem_2 = Ironbug_HVACSystem(AirLoops=flatten(airloop))

exporttoopenstudio_3 = Honeybee_ExportToOpenStudio(
    epwWeatherFile=epw_stat.epwFile,
    HBZones=flatten(glazingcreator.HBObjWGLZ),
    HVACSystem=flatten(hvacsystem_2),
    writeOSM=toggle_3,
    openOpenStudio=toggle_3,
    fileName="IB_Sys")  # -> readMe, osmFileAddress, idfFileAddress, resultFileAddress, eioFileAddress, rddFileAddress, htmlReport, studyFolder, model; plug-in component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
panel_6 = Panel(exporttoopenstudio_3.osmFileAddress)

# ----
# HBZones
data_2 = Data(flatten(glazingcreator.HBObjWGLZ))

lng_2 = ListLength(List=data_2)
thermalzone_2 = Ironbug_ThermalZone(HoneybeeZone=data_2, ZoneEquipments=ptac)

noairloop = Ironbug_NoAirLoop(OSZones=thermalzone_2)

lng_3 = ListLength(List=flatten(noairloop))
lng_4 = ListLength(List=flatten(thermalzone_2))
rec = DataRecorder(lng_3, DataLimit=-10, RecordData=True)
rec_2 = DataRecorder(lng_4, DataLimit=-10, RecordData=True)
panel_7 = Panel(rec)
panel_8 = Panel(rec_2)

# ----
# Hot water loop
boilerhw = Ironbug_BoilerHotWater()
pumpvariable = Ironbug_PumpVariableSpeed()
branches_2 = PlantBranches(Branch1=boilerhw)
branches_3 = PlantBranches(Branch1=coilhw.WaterSide_CoilHeatingWater)

spscheduled = Ironbug_SetpointManagerScheduled(Temperature="67")

hwloop = Ironbug_HotWaterPlantLoop(Supply=[pumpvariable, branches_2, spscheduled], Demand=branches_3)

hvacsystem_3 = Ironbug_HVACSystem(AirLoops=flatten(noairloop), PlantLoops=flatten(hwloop))

lng_5 = ListLength(List=hvacsystem_3)
lng_6 = ListLength(List=branches_3)
dam_2 = DataDam(DataA=hvacsystem_3, BufferDelay=10000000, BufferMode=0)  # disabled
rec_3 = DataRecorder(lng_5, DataLimit=-10, RecordData=True)
rec_4 = DataRecorder(lng_6, DataLimit=-10, RecordData=True)
panel_9 = Panel(rec_3)
rec_5 = DataRecorder(dam_2, DataLimit=-10, RecordData=True)  # disabled
panel_10 = Panel(rec_4)
panel_11 = Panel(rec_5)  # disabled

# ----
# PTHP
pthp = Ironbug_ZoneHVACPackagedTerminalHeatPump()

# ----
# HBZones
data_3 = Data()

thermalzone_3 = Ironbug_ThermalZone(HoneybeeZone=data_3, ZoneEquipments=pthp)
noairloop_2 = Ironbug_NoAirLoop(OSZones=thermalzone_3)

hvacsystem_4 = Ironbug_HVACSystem(AirLoops=flatten(noairloop_2))
